# Grasshopper definition GetData2.ghx (Grasshopper 1.0.8)
# plug-ins: RhinoCodePluginGH, Rhino.Inside for Autodesk Revit, Redback-Beta.GH

categories = BuiltInCategories("autodesk.revit.category.local:levels-1.0.0", SearchPattern="Levels")
panel = Panel("HostID")
catfltr = CategoryFilter(Categories=categories, Inverted=False)
elements = QueryElements(Filter=catfltr)  # -> Elements, Count
host = ElementHost(Element=elements.Elements)
param = ElementParameter(Element=graft(host), Parameter="__id")  # -> Element, Value
data = Data("é")
passport = ElementPassport(Element=graft(elements.Elements))  # -> DocumentGUID, Document, UniqueID, Id
param_2 = ElementParameter(Element=graft(elements.Elements), Parameter="__id")  # -> Element, Value
param_3 = ElementParameter(Element=graft(elements.Elements), Parameter="Name")  # -> Element, Value
rep = ReplaceText(Text=param_3.Value, Find=data, Replace="e", RecursiveReplace=False)
geometry = ElementGeometry(Elements=elements.Elements)
merge = Merge(Data1=rep)
merge_2 = Merge(Data1="Name")
expression = Expression(x=passport.DocumentGUID, y=passport.Id, Expression="Format(\"{0}_{1}\", x, y)")
mesh = MeshBrep(
    Brep=geometry,
    Settings={GridMaxCount=0, GridMinCount=16, JaggedSeams=False, MaxEdgeLength=0, MinEdgeLength=0.0001, MinTolerance=0, Refine=True, RefineAngle=0, RelativeTolerance=0.65, SimplePlanes=True, Tolerance=0})
json = CreateJSON(Keys=merge_2, Values=merge)
mjoin = MeshJoin(Meshes=mesh)
long = LongestList(ListA=mjoin, ListB="{}", PaddingMode=2)  # -> ListA, ListB
py3 = Python3Script(
    RUN=Toggle(False),
    NAME="level",
    IDENT=flatten(expression),
    ID=flatten(param_2.Value),
    PROPS=flatten(json),
    GEO=flatten(long.ListB))  # -> out, a; inputs IDENT: list, ID: list, PROPS: list, GEO: list
# ---------- py3: Python ----------
import requests
import json
a = []
if RUN:
    if not ID:
        ID = [None]*len(x)
    for u,v,w, props in zip(IDENT,ID,GEO,PROPS):
        #props = json.loads(props)
        data = {"enabled":True, "identifier":u, "name":NAME, "data":props, "project":"snowdontowers", "modularClassTags":[NAME]}

        if v:
            data["id"]= int(v)
        print(data)
        if "id" in data:
            r = requests.put("https://archmanucox.pythonanywhere.com/bimverse/nodes/%s/"%(int(v)), data=data)
        else:
            r = requests.post("https://archmanucox.pythonanywhere.com/bimverse/nodes/", data=data)
        #print(r)
        #print(r.text)
        print(r)
        node = r.json()

        print(node) 
        if node["geometryObjects"] == []:
            geometryData = {"geometry":w, "parentObject": node["id"], "name":"Rhino-Medium"}
            geomRequest = requests.post("https://archmanucox.pythonanywhere.com/bimverse/geometries/", data=geometryData)
        a.append(r.json()["id"])
# ---------- end py3 ----------
graft = GraftTree(Tree=py3.a, IncludeEmptyLists=True, IncludeNullItems=True)
identity = LevelIdentity(Level=elements.Elements)  # -> Name, Elevation, Structural, BuildingStory
param_4 = ElementParameter(Element=graft(elements.Elements), Parameter="__id", Value=graft)  # -> Element, Value
num = Number(identity.Elevation)
panel_2 = Panel(param_4.Value)
sort = SortList(Keys=num, ValuesA=flatten(param_4.Value))  # -> Keys, ValuesA
shift = ShiftList(List=sort.ValuesA, Shift=1, Wrap=False)
shift_2 = ShiftList(List=sort.ValuesA, Shift=-1, Wrap=False)
py3_2 = Python3Script(RUN=Toggle(False), name="level_adjacent", source=shift_2, target=shift)  # -> out, a
# ---------- py3_2: Python ----------
#r: requests
import requests
import json
a = []
if RUN:
    
    data = {"nodeObject_from":source,"nodeObject_to":target,"name":name, "project":"snowdontowers", "enabled":True}
    url = "https://archmanucox.pythonanywhere.com/bimverse/edges.json/?nodeObject_from={nodeObject_from}&nodeObject_to={nodeObject_to}&name={name}".format(**data)
    print(url)
    check = requests.get(url)
    print(check.json())
    if len(check.json()) == 0:
        r = requests.post("https://archmanucox.pythonanywhere.com/bimverse/edges/", data=data)
        edge = r.json()
        print(edge)
# ---------- end py3_2 ----------
panel_3 = Panel(shift_2)
geo = Geometry(<brep referenced from the Rhino model>)  # disabled
object = ModelObject(Object=geo)  # -> Object, Geometry, Name, Layer, Visibility, Display, Drafting, Render; disabled
layer_path = LayerPath(Layer=object.Layer)  # disabled
graphical_element = GraphicalElement([<wall referenced from the Revit model> x2])
objects = QueryModelObjects(Layer=layer_path, Locked=True, Hidden=True, AutoUpdateState=True)  # disabled
py3_3 = Python3Script(x=graphical_element)  # -> out, a
# ---------- py3_3: Python ----------
import clr

# add reference to base system types e.g. Enum
clr.AddReference('System.Core')

# add reference to API provided by Rhino.Inside.Revit
clr.AddReference('RhinoInside.Revit')

# add reference to Revit API (two DLLs)
clr.AddReference('RevitAPI') 
clr.AddReference('RevitAPIUI')
# from System.Core DLL
from System import Enum, Action

# Rhino.Inside.Revit API
import RhinoInside as ri
from RhinoInside.Revit import Revit, Convert



# Revit API
from Autodesk.Revit import DB
from Autodesk.Revit import UI


locationCurves = x.Location.Curve
print(locationCurves)
print(dir(locationCurves))

a = ri.Revit.Convert.Geometry.GeometryDecoder.ToCurve(locationCurves)
# ---------- end py3_3 ----------
geometry_2 = ElementGeometry(Elements=graphical_element)
item = ListItem(List=objects, Index=[0, 1, 2, 3], Wrap=True)  # disabled
panel_4 = Panel(py3_3.a)
panel_5 = Panel("{}")  # disabled
geo_2 = Geometry([<curve referenced from the Rhino model> x28])  # disabled
panel_6 = Panel("id")  # disabled
expression_2 = Expression(Expression="Format(\"{0}, {1}\", x, y)")
serialize_geometry = Python3Script(GE=geo_2, PR=panel_5)  # -> out, JO; inputs GE: GeometryBase; disabled
# ---------- serialize_geometry: Python ----------
import json
if not PR:
    PR = "{}"

PR = json.loads(PR)

data = json.loads(GE.ToJSON(None))
data["properties"] = PR
#print(list(data))

JO = json.dumps(data)
# ---------- end serialize_geometry ----------
u_text = UserText(Content=item, Keys=panel_6, UserTextMode=1)  # -> Content, Values; disabled
panel_7 = Panel(u_text.Values)  # disabled
geo_3 = Geometry(<brep referenced from the Rhino model>)
serialize_geometry_2 = SerializeGeometry(Geometry=geo_2, PR=panel_5)  # disabled
object_2 = ModelObject(Object=graft(item))  # -> Object, Geometry; disabled
details = ContentDetails(Content=graft(item))  # -> Content, Id, Path, Attributes; disabled
panel_8 = Panel("{}")  # disabled
panel_9 = Panel("2")  # disabled
object_3 = ModelObject(Object=geo_3)  # -> Object, Geometry, Name, Layer, Visibility, Display, Drafting, Render
categories_2 = BuiltInCategories("autodesk.revit.category.local:rooms-1.0.0", SearchPattern="Room")
categories_3 = BuiltInCategories("autodesk.revit.category.local:walls-1.0.0", SearchPattern="Walls")
list = ValueList({"Rhino-Medium", "Rhino-Detailed", "LaserCutter"}, selected="Rhino-Medium")  # disabled
information = ContentInformation(Content=geo_2)  # -> Content, Parent, Name, Tags; disabled
details_2 = ContentDetails(Content=geo_2)  # -> Content, Id, Path, Attributes; disabled
toggle = BooleanToggle(False)  # disabled
serialize_geometry_3 = SerializeGeometry(Geometry=object_2.Geometry, PR=panel_8)  # disabled
layer_path_2 = LayerPath(Layer=object_3.Layer)  # disabled
categories_4 = BuiltInCategories("autodesk.revit.category.family:doors-1.0.0", SearchPattern="Doors")
levels = QueryLevels(BuildingStory=True)
line = Line(Line((23.43682309, -15.94068946, 6.615565578), (27.63925223, 10.00088694, 0.8440000029)))  # disabled
py3_4 = Python3Script(index=panel_9, x=list)  # -> out, a; disabled
# ---------- py3_4: Python ----------
# r: requests
import json
import requests

r = requests.get("http://archmanucox.pythonanywhere.com/bimverse/nodes/%s.json"%index)
data = r.json()

a = []

for i in data["geometryObjects"]:   
    if i["name"] == x:
        if type(i["geometry"]) == type([]):
            for g in i["geometry"]:
                a.append(json.dumps(g))
                appendObject = "list"
        else:
            appendObject= json.dumps(i["geometry"])

if not appendObject:
    appendObject= json.dumps(data[index]["geometryObjects"][0]["geometry"])
if appendObject != "list":
    a.append(appendObject)
# ---------- end py3_4 ----------
py3_5 = Python3Script(u=toggle, x=flatten(details.Id), z=flatten(u_text.Values), y=flatten(serialize_geometry_3))  # -> out, a; inputs x: list, z: list, y: list; disabled
# ---------- py3_5: Python ----------
import requests
a = []
if u:
    if not z:
        z = [None]*len(x)
    for u,v,w in zip(x,z,y):
        data = {"enabled":True, "identifier":u, "name":"Floor Slab"}

        if v:
            data["id"]= int(v)
        print(data)
        if "id" in data:
            r = requests.put("https://archmanucox.pythonanywhere.com/bimverse/nodes/%s/"%(int(v)), data=data)
        else:
            r = requests.post("https://archmanucox.pythonanywhere.com/bimverse/nodes/", data=data)
        print(r)
        #print(r.text)
        print(r.json())
        a.append(r.json()["id"])
# ---------- end py3_5 ----------
objects_2 = QueryModelObjects(Layer=layer_path_2, Locked=True, Hidden=True, AutoUpdateState=True)  # disabled
py3_6 = Python3Script(RUN=Toggle(False))  # -> out, ids, identifier
# ---------- py3_6: Python ----------
import requests
import json

if RUN:
    r = requests.get("https://archmanucox.pythonanywhere.com/bimverse/nodes/")
    data = r.json()
    print(data)
    identifier = list(map(lambda x: x["identifier"], data))
    ids = list(map(lambda x: x["id"], data))
    #data = list(map(lambda x: json.dumps(x),data))
    #J = data
# ---------- end py3_6 ----------
item_2 = ListItem(List=levels, Index=0, Wrap=True)
panel_10 = Panel("id")  # disabled
geo2arch = Geo2Arch(Geometry=line)  # disabled
catfltr_2 = CategoryFilter(Categories=categories_3, Inverted=False)
catfltr_3 = CategoryFilter(Categories=categories_2, Inverted=False)
toggle_2 = BooleanToggle(False)  # disabled
u_text_2 = UserText(Content=graft(item), Keys=panel_10, Values=graft(py3_5.a), UserTextMode=1)  # -> flatten(Content), Keys, Values; disabled
py3_7 = Python3Script()  # -> out, N, E; disabled
# ---------- py3_7: Python ----------
# r: requests
import json
import requests
import ghpythonlib as ghp

r = requests.get("http://localhost:8000/bimverse/edges/")
data = r.json()

#print(data)
nodes = []
edges = []
for i in data:
    if i["nodeObject_from"] not in nodes:
        nodes.append(i["nodeObject_from"])
    if i["nodeObject_to"] not in nodes:
        nodes.append(i["nodeObject_to"])
    f = nodes.index(i["nodeObject_from"])
    t = nodes.index(i["nodeObject_to"])
    edges.append([f,t])

N = nodes
E = ghp.treehelpers.list_to_tree(edges)
# ---------- end py3_7 ----------
tmatch = MatchText(Text=py3_6.identifier, RegEx="[a-z 0-9]{8}", Case=True)
item_3 = ListItem(List=objects_2, Index=[0, 1, 2, 3], Wrap=True)  # disabled
deserialize_geometry_json = DeserializeGeometryJSON(Geometry=py3_4.a)  # -> JSONObject, PR; disabled
elements_2 = QueryElements(Filter=catfltr_2)  # -> Elements, Count
elements_3 = QueryElements(Filter=catfltr_3)  # -> Elements, Count
catfltr_4 = CategoryFilter(Categories=categories_4, Inverted=False)
graphical_element_2 = GraphicalElement([<familyinstance referenced from the Revit model> x4])
graphical_element_3 = GraphicalElement([<wall referenced from the Revit model> x6])
graphical_element_4 = GraphicalElement([<roomelement referenced from the Revit model> x4])
panel_11 = Panel(py3_5.a)  # disabled
deserialize_geometry_json_2 = Python3Script(JO=py3_4.a)  # -> out, GE, PR; inputs JO: String; disabled
# ---------- deserialize_geometry_json_2: Python ----------
import json
import Rhino as rh

PR = json.dumps(json.loads(JO)["properties"])

GE = rh.Geometry.GeometryBase.FromJSON(JO)
# ---------- end deserialize_geometry_json_2 ----------
lng = ListLength(List=py3_7.N)  # disabled
host_2 = ElementHost(Element=elements_3.Elements)
geo_4 = Geometry(deserialize_geometry_json.JSONObject)  # disabled
dispatch = Dispatch(List=py3_6.ids, DispatchPattern=tmatch)  # -> ListA, ListB
dispatch_2 = Dispatch(List=py3_6.identifier, DispatchPattern=tmatch)  # -> ListA, ListB
cache = ContentCache(Content=u_text_2.Content, Action=toggle_2)  # disabled
panel_13 = Panel("""Name
Number""")
elements_4 = QueryElements(Filter=catfltr_4)  # -> Elements, Count
pop2d = Populate2D(Region={Plane=PlaneXY(0, 0, 0), Size=Domain2(u=0..20, v=0..10)}, Count=lng, Seed=1)  # disabled
data_2 = Data("é")
data_3 = Data("é")
param_5 = ElementParameter(Element=graft(host_2), Parameter="__id")  # -> Element, Value
item_4 = ListItem(List=dispatch.ListA, Index=0, Wrap=True)
item_5 = ListItem(List=dispatch_2.ListA, Index=0, Wrap=True)
passport_2 = ElementPassport(Element=graft(elements_2.Elements))  # -> DocumentGUID, Document, UniqueID, Id
passport_3 = ElementPassport(Element=graft(elements_3.Elements))  # -> DocumentGUID, Document, UniqueID, Id
object_4 = ModelObject(Geometry=geo_4)  # -> Object, Geometry, Name, Layer, Visibility, Display, Drafting, Render; disabled
param_6 = ElementParameter(Element=graft(elements_2.Elements), Parameter="__id")  # -> Element, Value
param_7 = ElementParameter(Element=graft(elements_3.Elements), Parameter="__id")  # -> Element, Value
item_6 = ListItem(List=pop2d, Index=py3_7.E, Wrap=True)  # disabled
param_8 = ElementParameter(Element=graft(elements_2.Elements), Parameter="Length")  # -> Element, Value
param_9 = ElementParameter(Element=graft(elements_3.Elements), Parameter=panel_13)  # -> Element, Value
param_10 = ElementParameter(Element=graft(elements_3.Elements), Parameter=panel_13)  # -> Element, Value
rep_2 = ReplaceText(Text=param_8.Value, Find=data_3, Replace="e", RecursiveReplace=False)
rep_3 = ReplaceText(Text=param_10.Value, Find=data_2, Replace="e", RecursiveReplace=False)
geometry_3 = ElementGeometry(Elements=elements_2.Elements)
geometry_4 = ElementGeometry(Elements=elements_3.Elements)
data_4 = Data("é")
passport_4 = ElementPassport(Element=graft(elements_4.Elements))  # -> DocumentGUID, Document, UniqueID, Id
object_5 = ModelObject(Object=item_5)  # -> Object, Geometry, Name, Layer, Visibility, Display, Drafting, Render
toggle_3 = BooleanToggle(False)  # disabled
param_11 = ElementParameter(Element=graft(elements_4.Elements), Parameter="__id")  # -> Element, Value
pline = PolyLine(Vertices=item_6, Closed=False)  # disabled
param_12 = ElementParameter(Element=graft(elements_4.Elements), Parameter="Mark")  # -> Element, Value
rep_4 = ReplaceText(Text=param_12.Value, Find=data_4, Replace="e", RecursiveReplace=False)
merge_3 = Merge(Data1=rep_2)
merge_4 = Merge(Data1=rep_3)
geometry_5 = ElementGeometry(Elements=elements_4.Elements)
merge_5 = Merge(Data1="Length")
merge_6 = Merge(Data1=panel_13)
expression_3 = Expression(x=passport_2.DocumentGUID, y=passport_2.Id, Expression="Format(\"{0}_{1}\", x, y)")
expression_4 = Expression(x=passport_3.DocumentGUID, y=passport_3.Id, Expression="Format(\"{0}_{1}\", x, y)")
mesh_2 = MeshBrep(
    Brep=geometry_3,
    Settings={GridMaxCount=0, GridMinCount=16, JaggedSeams=False, MaxEdgeLength=0, MinEdgeLength=0.0001, MinTolerance=0, Refine=True, RefineAngle=0, RelativeTolerance=0.65, SimplePlanes=True, Tolerance=0})
mesh_3 = MeshBrep(
    Brep=geometry_4,
    Settings={GridMaxCount=0, GridMinCount=16, JaggedSeams=False, MaxEdgeLength=0, MinEdgeLength=0.0001, MinTolerance=0, Refine=True, RefineAngle=0, RelativeTolerance=0.65, SimplePlanes=True, Tolerance=0})
json_2 = CreateJSON(Keys=merge_6, Values=merge_4)
u_text_3 = UserText(Content=item_3, Keys="id", UserTextMode=1)  # -> Content, Values
py3_8 = Python3Script()  # -> out, a; disabled
# ---------- py3_8: Python ----------
import requests

r = requests.get("https://archmanucox.pythonanywhere.com/bimverse/nodes/169.json")
print(r.json())

data = {"name":"FromGHPY2","enabled":True}
#postR = requests.post("https://archmanucox.pythonanywhere.com/bimverse/nodes/", data=data)

putR = requests.put("https://archmanucox.pythonanywhere.com/bimverse/nodes/171/", data=data)

print(putR.json())
# ---------- end py3_8 ----------
json_3 = CreateJSON(Keys=merge_5, Values=merge_3)
cache_2 = ContentCache(Content=object_4.Object, Action=toggle_3)  # disabled
merge_7 = Merge(Data1="Mark")
merge_8 = Merge(Data1=rep_4)
mjoin_2 = MeshJoin(Meshes=mesh_2)
mjoin_3 = MeshJoin(Meshes=mesh_3)
expression_5 = Expression(x=passport_4.DocumentGUID, y=passport_4.Id, Expression="Format(\"{0}_{1}\", x, y)")
panel_15 = Panel(item_6)  # disabled
json_4 = CreateJSON(Keys=merge_7, Values=merge_8)
object_6 = ModelObject(Object=graft(item_3))  # -> Object, Geometry; disabled
details_3 = ContentDetails(Content=graft(item_3))  # -> Content, Id, Path, Attributes; disabled
serialize_geometry_4 = SerializeGeometry(Geometry=geometry_3, PR="{}")
long_2 = LongestList(ListA=mjoin_2, ListB="{}", PaddingMode=2)  # -> ListA, ListB
long_3 = LongestList(ListA=mjoin_3, ListB="{}", PaddingMode=2)  # -> ListA, ListB
item_7 = ListItem(List=geometry_5, Index=0, Wrap=True)
serialize_geometry_5 = SerializeGeometry(Geometry=geometry_4, PR="{}")
u_text_4 = UserText(Content=graft(object_5.Object), Keys="id", Values=graft(item_4), UserTextMode=1)  # -> flatten(Content), Keys, Values
panel_16 = Panel(u_text_3.Values)  # disabled
long_4 = LongestList(ListA=item_7, ListB="{}", PaddingMode=2)  # -> ListA, ListB
nullrep = ReplaceNulls(Items=serialize_geometry_4, Replacements="{}")  # -> Items, Count
py3_9 = Python3Script(
    RUN=Toggle(False),
    NAME="wall",
    IDENT=flatten(expression_3),
    ID=flatten(param_6.Value),
    PROPS=flatten(json_3),
    GEO=flatten(nullrep.Items))  # -> out, a; inputs IDENT: list, ID: list, PROPS: list, GEO: list; same code as py3
py3_10 = Python3Script(
    RUN=Toggle(False),
    NAME="room",
    IDENT=flatten(expression_4),
    ID=flatten(param_7.Value),
    PROPS=flatten(json_2),
    GEO=flatten(serialize_geometry_5))  # -> out, a; inputs IDENT: list, ID: list, PROPS: list, GEO: list; same code as py3
graft_2 = GraftTree(Tree=py3_9.a, IncludeEmptyLists=True, IncludeNullItems=True)
graft_3 = GraftTree(Tree=py3_10.a, IncludeEmptyLists=True, IncludeNullItems=True)
cache_3 = ContentCache(Content=u_text_4.Content, Action=Toggle(True))
py3_11 = Python3Script(
    RUN=Toggle(False),
    NAME="door",
    IDENT=flatten(expression_5),
    ID=flatten(param_11.Value),
    PROPS=flatten(json_4),
    GEO=flatten(long_4.ListB))  # -> out, a; inputs IDENT: list, ID: list, PROPS: list, GEO: list; same code as py3
graft_4 = GraftTree(Tree=py3_11.a, IncludeEmptyLists=True, IncludeNullItems=True)
param_13 = ElementParameter(Element=graft(elements_2.Elements), Parameter="__id", Value=graft_2)  # -> Element, Value
param_14 = ElementParameter(Element=graft(elements_3.Elements), Parameter="__id", Value=graft_3)  # -> Element, Value
panel_17 = Panel(object_5.Object)
param_15 = ElementParameter(Element=graft(elements_4.Elements), Parameter="__id", Value=graft_4)  # -> Element, Value
param_16 = ElementParameter(Element=param_13.Element, Parameter="Base Constraint")  # -> Element, Value
param_17 = ElementParameter(Element=param_14.Element, Parameter="Level")  # -> Element, Value
host_3 = ElementHost(Element=param_15.Element)
param_18 = ElementParameter(Element=param_15.Element, Parameter="Level")  # -> Element, Value
param_19 = ElementParameter(Element=param_16.Value, Parameter="__id")  # -> Element, Value
param_20 = ElementParameter(Element=param_17.Value, Parameter="__id")  # -> Element, Value
param_21 = ElementParameter(Element=graft(host_3), Parameter="__id")  # -> Element, Value
param_22 = ElementParameter(Element=param_18.Value, Parameter="__id")  # -> Element, Value
py3_12 = Python3Script(RUN=Toggle(False), name="level", source=param_13.Value, target=param_19.Value)  # -> out, a; same code as py3_2
py3_13 = Python3Script(RUN=Toggle(False), name="level", source=param_14.Value, target=param_20.Value)  # -> out, a; same code as py3_2
py3_14 = Python3Script(RUN=Toggle(False), name="level", source=param_15.Value, target=param_22.Value)  # -> out, a; same code as py3_2
panel_18 = Panel(param_7.Value)  # disabled
panel_19 = Panel("id")  # disabled
panel_20 = Panel("""0	1
1	0
1	2
2	1
3	0
0	3""")  # disabled
panel_21 = Panel("room_connected")  # disabled
panel_22 = Panel("""0	1
1	0
1	2
2	1
3	0
0	3""")  # disabled
panel_23 = Panel("room_adjacent")  # disabled
toggle_4 = BooleanToggle(False)  # disabled
u_text_5 = UserText(Content=graft(item_3), Keys=panel_19, UserTextMode=1)  # -> flatten(Content), Keys, Values; disabled
panel_24 = Panel("\t")  # disabled
panel_25 = Panel("\t")  # disabled
split = TextSplit(Text=panel_20, Separators=panel_24)  # disabled
split_2 = TextSplit(Text=panel_22, Separators=panel_25)  # disabled
toggle_5 = BooleanToggle(False)  # disabled
toggle_6 = BooleanToggle(False)  # disabled
cache_4 = ContentCache(Content=u_text_5.Content, Action=toggle_4)  # disabled
item_8 = ListItem(List=py3_10.a, Index=split, Wrap=True)  # disabled
item_9 = ListItem(List=py3_10.a, Index=split_2, Wrap=True)  # disabled
py3_15 = Python3Script(RUN=toggle_5, name=panel_21, ids=item_8)  # -> out, a; inputs ids: list; disabled
# ---------- py3_15: Python ----------
import requests
import json
a = []
if RUN:
    data = {"nodeObject_from":ids[0],"nodeObject_to":ids[1],"name":name}
    r = requests.post("https://archmanucox.pythonanywhere.com/bimverse/edges/", data=data)
    edge = r.json()
    print(edge)
# ---------- end py3_15 ----------
py3_16 = Python3Script(RUN=toggle_6, name=panel_23, ids=item_9)  # -> out, a; inputs ids: list; disabled; same code as py3_15
panel_26 = Panel(item_9)  # disabled
