# Grasshopper definition diagrams.gh (Grasshopper 1.0.8)
# plug-ins: RhinoCodePluginGH, SpiderWeb :: Graph Tools, ClipperComponents, Human, Squid, Redback-Beta.GH, Kangaroo2 Components

dpipeline = DynamicGeometryPipeline(
    LayerFilter="nodes",
    TypeFilter="Point",
    NameFilter="*",
    GroupByLayer=False,
    GroupByType=False,
    IncludeHidden=True,
    IncludeLocked=True,
    enableFullPath=False,
    listenToAttributes=True)
dpipeline_2 = DynamicGeometryPipeline(
    LayerFilter="edges",
    TypeFilter="Curve",
    NameFilter="*",
    GroupByLayer=False,
    GroupByType=False,
    IncludeHidden=True,
    IncludeLocked=True,
    enableFullPath=False,
    listenToAttributes=True)
polygon = Polygon(Plane=PlaneXY(0, 0, 0), Radius=Slider(0.328, range=0..1), Segments=6, FilletRadius=0)  # -> Polygon, Length
panel = Panel("""{"featureClass":{"font-size":"4"},
"geometry":{"font-size":"4"},
"node":{"font-size":"6"}
}""")
rotate = Rotate(Geometry=polygon.Polygon, Angle=degrees(30), Plane=PlaneXY(0, 0, 0))  # -> Geometry, Transform
u_text = UserText(Content=dpipeline, UserTextMode=1)  # -> Content, Keys, Values
graft = GraftTree(Tree=dpipeline, IncludeEmptyLists=True, IncludeNullItems=True)
u_text_2 = UserText(Content=dpipeline, Keys="class", UserTextMode=1)  # -> Content, Values
u_text_3 = UserText(Content=dpipeline, Keys="label", UserTextMode=1)  # -> Content, Values
polygon_2 = Polygon(Plane=PlaneXY(0, 0, 0), Radius=Slider(0.317, range=0..1), Segments=4, FilletRadius=0)  # -> Polygon, Length
cir = Circle(Plane=PlaneXY(0, 0, 0), Radius=Slider(0.7, range=0..1))
xy = XYPlane(Origin=graft(graft))
json = CreateJSON(Keys=u_text.Keys, Values=u_text.Values)  # disabled
cset = CreateSet(List=flatten(u_text_2.Values))  # -> Set, Map
panel_2 = Panel("""featureClass
geometry
node""")
read_json = ReadJSON(JSONObject=json, Keys="label")  # disabled
merge = Merge(Data1=flatten(polygon_2.Polygon), Data2=flatten(rotate.Geometry), Data3=flatten(cir))
u_text_4 = UserText(Content=dpipeline_2, Keys="label", UserTextMode=1)  # -> Content, Values
join = TextJoin(Text=panel)
u_text_5 = UserText(Content=dpipeline_2, Keys="arrow-s", UserTextMode=1)  # -> Content, Values
u_text_6 = UserText(Content=dpipeline_2, Keys="arrow-t", UserTextMode=1)  # -> Content, Values
u_text_7 = UserText(Content=dpipeline_2, Keys="class", UserTextMode=1)  # -> Content, Values
polygon_3 = Polygon(Plane=PlaneXY(0, 0, 0), Radius=3, Segments=3, FilletRadius=0)  # -> Polygon, Length
scale = Scale(Geometry=merge, Center=Point(0, 0, 0), Factor=Slider(124.404, range=0..500))  # -> Geometry, Transform
json_keys = JSONKeys(JO=join)
i = Index(0)
project = Project(Geometry=dpipeline_2, Plane=PlaneXY(0, 0, 0))  # -> Geometry, Transform
xy_2 = XYPlane(Origin=Point(0, 0, 0))
explode = Explode(Curve=polygon_3.Polygon, Recursive=True)  # -> Segments, Vertices
read_json_2 = ReadJSON(JSONObject=join, Keys=panel_2)
item = ListItem(List=explode.Segments, Index=i, Wrap=True)
mindex = MemberIndex(Set=panel_2, Member=u_text_2.Values)  # -> Index, Count
item_2 = ListItem(List=scale.Geometry, Index=mindex.Index, Wrap=True)
item_3 = ListItem(List=panel_2, Index=mindex.Index, Wrap=True)
cull_i = CullIndex(List=explode.Segments, Indices=i, Wrap=True)
dispatch = Dispatch(List=Slider(1, range=0..1), DispatchPattern=u_text_6.Values)  # -> ListA, ListB
dispatch_2 = Dispatch(List=Slider(0, range=0..1), DispatchPattern=u_text_5.Values)  # -> ListA, ListB
hframe = HorizontalFrame(Curve=reparameterize(graft(project.Geometry)), Parameter=0.5)
join_2 = JoinCurves(Curves=cull_i, Preserve=False)
paragraph = Paragraph(HAlign=1, VAlign=1, RightLeft=False)
read_json_3 = ReadJSON(JSONObject=read_json_2, Keys="font-size")  # -> flatten(Values)
expression = Expression(x=read_json_3, y=Slider(6, range=0..20), Expression="x*y")
font = Font(Family="Space Grotesk", Size=expression, Bold=Toggle(True), Italic=False, Underline=False)
explode_2 = Explode(Curve=join_2, Recursive=True)  # -> Segments, Vertices
orient = Orient(Geometry=item_2, Source=PlaneXY(0, 0, 0), Target=xy)  # -> Geometry, Transform
item_4 = ListItem(List=font, Index=mindex.Index, Wrap=True)
paragraph_2 = Paragraph(HAlign=1, VAlign=1, RightLeft=False)
font_2 = Font(Family="Space Grotesk", Size=Slider(20, range=0..50), Bold=Toggle(True), Italic=False, Underline=False)
item_5 = ListItem(List=explode_2.Vertices, Index=1, Wrap=True)
textc = TextCurves(Plane=xy, Text=u_text_3.Values, Font=item_4, Paragraph=paragraph)
xy_3 = XYPlane(Origin=item_5)
crv_cp = CurveClosestPoint(Point=item_5, Curve=item)  # -> Point, Parameter, Distance
boundary = BoundarySurfaces(Edges=textc)
textc_2 = TextCurves(Plane=hframe, Text=u_text_4.Values, Font=font_2, Paragraph=paragraph_2)
vec2pt = Vector2Pt(PointA=crv_cp.Point, PointB=item_5, Unitize=False)  # -> Vector, Length
debrep = DeconstructBrep(Brep=boundary)  # -> Faces, Edges, Vertices
boundary_2 = BoundarySurfaces(Edges=textc_2)
scale_2 = Scale(Geometry=join_2, Center=item_5, Factor=Slider(5, range=0..500))  # -> Geometry, Transform
align = AlignPlane(Plane=xy_3, Direction=vec2pt.Vector)  # -> Plane, Angle
join_3 = JoinCurves(Curves=debrep.Edges, Preserve=False)
debrep_2 = DeconstructBrep(Brep=boundary_2)  # -> Faces, Edges, Vertices
len = Length(Curve=join_3)
join_4 = JoinCurves(Curves=debrep_2.Edges, Preserve=False)
sort = SortList(Keys=len, ValuesA=join_3)  # -> Keys, reverse(simplify(ValuesA))
len_2 = Length(Curve=join_4)
cull_i_2 = CullIndex(List=sort.ValuesA, Indices=0, Wrap=True)
item_6 = ListItem(List=sort.ValuesA, Index=0, Wrap=True)
xy_4 = XYPlane(Origin=Point(0, 0, 0))
sort_2 = SortList(Keys=len_2, ValuesA=join_4)  # -> Keys, reverse(simplify(ValuesA))
topoly = CurveToPolyline(Curve=orient.Geometry, ToleranceDistance=0.1, ToleranceAngle=0)  # -> Polyline, Segments
topoly_2 = CurveToPolyline(Curve=item_6, ToleranceDistance=0.1, ToleranceAngle=0)  # -> Polyline, Segments
polyoffset = PolylineOffset(
    Polylines=flatten([topoly_2.Polyline, orient.Geometry]),
    Distance=20,
    Plane=Plane(origin=(0, 0, 0), x=(0, 0, 0), y=(0, 0, 0)),
    Tolerance=0.01,
    ClosedFillet=1,
    OpenFillet=1,
    Miter=2)  # -> Contour, Holes
crv = Curve(polyoffset.Contour)
project_2 = Project(Geometry=crv, Plane=PlaneXY(0, 0, 0))  # -> Geometry, Transform
trim = TrimWithRegions(Curve=graft(project.Geometry), Regions=project_2.Geometry, Plane=xy_2)  # -> Inside, Outside
len_3 = Length(Curve=trim.Outside)
sort_3 = SortList(Keys=len_3, ValuesA=trim.Outside)  # -> Keys, reverse(ValuesA)
item_7 = ListItem(List=sort_3.ValuesA, Index=0, Wrap=True)
hframe_2 = HorizontalFrame(Curve=reparameterize(item_7), Parameter=dispatch_2.ListA)
hframe_3 = HorizontalFrame(Curve=reparameterize(item_7), Parameter=dispatch.ListA)
prot = RotatePlane(Plane=hframe_2, Angle=degrees(180))
orient_2 = Orient(Geometry=scale_2.Geometry, Source=align.Plane, Target=[hframe_3, prot])  # -> Geometry, Transform
topoly_3 = CurveToPolyline(Curve=item_7, ToleranceDistance=0.1, ToleranceAngle=0)  # -> Polyline, Segments
geo2arch = Geo2Arch(Geometry=flatten(orient_2.Geometry), Properties=flatten("{}"))
cull_i_3 = CullIndex(List=sort_2.ValuesA, Indices=0, Wrap=True)
item_8 = ListItem(List=sort_2.ValuesA, Index=0, Wrap=True)
topoly_4 = CurveToPolyline(Curve=cull_i_2, ToleranceDistance=0.1, ToleranceAngle=0)  # -> Polyline, Segments
svg_layout = SVGLayout(P=xy_4, D="A4", S="1:10", L=True)  # -> L, R
geo2arch_2 = Geo2Arch(Geometry=flatten(topoly_3.Polyline), Properties=flatten(u_text_7.Values))
panel_3 = Panel("""*{fill:none; stroke-width:0.15mm; stroke-linejoin:round; stroke-linecap: round; stroke:black;}
.dbRelationship{
stroke-dasharray: 0.5mm 0.5mm;}""")
clean = CleanTree(RemoveNulls=True, RemoveInvalid=True, RemoveEmpty=False, Tree=item_8)
geo2arch_3 = Geo2Arch(Geometry=flatten(topoly.Polyline), Properties=flatten(item_3))
geo2arch_4 = Geo2Arch(Geometry=flatten(topoly_2.Polyline), Properties="{}")
geo2arch_5 = Geo2Arch(Geometry=flatten(topoly_4.Polyline), Properties="{}")
topoly_5 = CurveToPolyline(Curve=clean, ToleranceDistance=0.1, ToleranceAngle=0)  # -> Polyline, Segments
topoly_6 = CurveToPolyline(Curve=cull_i_3, ToleranceDistance=0.1, ToleranceAngle=0)  # -> Polyline, Segments
crv_2 = Curve(svg_layout.R)
mergearchjson = MergeArchJSON(AJ=flatten([geo2arch_2, geo2arch]))
geo2arch_6 = Geo2Arch(Geometry=flatten(topoly_5.Polyline), Properties="{}")
geo2arch_7 = Geo2Arch(Geometry=flatten(topoly_6.Polyline), Properties="{}")
panel_4 = Panel("""*{fill:white; stroke-width:0.3mm; stroke-linejoin:round;}
.geometry{stroke:#F50057;}
.featureClass{stroke:#00BCD4;}
.node{stroke:#4CAF50;}""")
svg = SVGGenerator(JO=geo2arch_4, LA=svg_layout.L)
svg_2 = SVGGenerator(JO=geo2arch_5, LA=svg_layout.L)
svg_3 = SVGGenerator(JO=mergearchjson, LA=svg_layout.L, CSS=panel_3)
svg_4 = SVGGenerator(JO=geo2arch_3, LA=svg_layout.L, CSS=panel_4)
rel_path = RelativePath(Path=False, RelativePath="svg\edges.svg")  # -> FullPath, Directory, FileName
svg_5 = SVGGenerator(JO=geo2arch_7, LA=svg_layout.L)
toggle = BooleanToggle(True)
svg_6 = SVGGenerator(JO=geo2arch_6, LA=svg_layout.L)
rel_path_2 = RelativePath(Path=False, RelativePath="svg\labels-bo.svg")  # -> FullPath, Directory, FileName
rel_path_3 = RelativePath(Path=False, RelativePath="svg\labels.svg")  # -> FullPath, Directory, FileName
rel_path_4 = RelativePath(Path=False, RelativePath="svg\symbols.svg")  # -> FullPath, Directory, FileName
rel_path_5 = RelativePath(Path=False, RelativePath="svg\e-labels-bo.svg")  # -> FullPath, Directory, FileName
rel_path_6 = RelativePath(Path=False, RelativePath="svg\e-labels.svg")  # -> FullPath, Directory, FileName
write = WriteFile(Run=toggle, Content=svg_3, FileDirectory=rel_path.Directory, FileName=rel_path.FileName)
py3 = Python3Script()  # -> out, nodes, sourceIndex, targetIndex
# ---------- py3: Python ----------
import requests
import Rhino as rh
import json

edges = requests.get("https://archmanucox.pythonanywhere.com/bimverse/edges.json/?name=room_connected&project=snowdontowers&nodeObject_from__modularClassTags__name=room").json()

edges = edges+requests.get("https://archmanucox.pythonanywhere.com/bimverse/edges.json/?name=room_connected&project=snowdontowers&nodeObject_to__modularClassTags__name=room").json()

nodes = []
sourceIndex = []
targetIndex = []
for edge in edges:
    if edge["nodeObject_from"] not in nodes:
        nodes.append(edge["nodeObject_from"])
    if edge["nodeObject_to"] not in nodes:
        nodes.append(edge["nodeObject_to"])
    sourceIndex.append(nodes.index(edge["nodeObject_from"]))
    targetIndex.append(nodes.index(edge["nodeObject_to"]))
# ---------- end py3 ----------
write_2 = WriteFile(Run=toggle, Content=svg_4, FileDirectory=rel_path_4.Directory, FileName=rel_path_4.FileName)
write_3 = WriteFile(Run=toggle, Content=svg_2, FileDirectory=rel_path_2.Directory, FileName=rel_path_2.FileName)
write_4 = WriteFile(Run=toggle, Content=svg, FileDirectory=rel_path_3.Directory, FileName=rel_path_3.FileName)
lng = ListLength(List=py3.nodes)
panel_5 = Panel(write)
merge_2 = Merge(Data1=graft(py3.sourceIndex), Data2=graft(py3.targetIndex))
expression_2 = Expression(x=lng, Expression="ceiling(x^0.5)")
write_5 = WriteFile(Run=toggle, Content=svg_5, FileDirectory=rel_path_5.Directory, FileName=rel_path_5.FileName)
write_6 = WriteFile(Run=toggle, Content=svg_6, FileDirectory=rel_path_6.Directory, FileName=rel_path_6.FileName)
py3_2 = Python3Script()  # -> out, items; disabled
# ---------- py3_2: Python ----------
import requests
import Rhino as rh
import json

level = requests.get("https://archmanucox.pythonanywhere.com/bimverse/nodes-light.json/?modularClassTags__name=level&project=snowdontowers").json()
#print(level[0])
items = []
for i in level[0]["nodeObject_from"]:
    #items.append(i["nodeObject_from"])
    url = "https://archmanucox.pythonanywhere.com/bimverse/nodes/{}.json/".format(i["nodeObject_from"])
    #print(url)
    item = requests.get(url).json()
    try:
        geom = rh.Geometry.GeometryBase.FromJSON(json.dumps(item["geometryObjects"][0]["geometry"]))
        items.append(geom)
        #print(item)
    except: pass
# ---------- end py3_2 ----------
panel_6 = Panel(write_2)
panel_7 = Panel(write_4)
panel_8 = Panel(write_3)
dtg = DataTreeToGraph(DataTree=merge_2, methode=2)
brep = Brep(py3_2.items)  # disabled
panel_9 = Panel(write_6)
brep_2 = Brep(py3.nodes)  # disabled
panel_10 = Panel(write_5)
pop3d = Populate3D(
    Region={Plane=PlaneXY(28.42930427, -27.48993281, 0), X=Domain(0, 1691.212713), Y=Domain(0, 2020.301211), Z=Domain(0, 1237.691463)},
    Count=lng,
    Seed=1)
hexgrid = Hexagonal(Plane=PlaneXY(0, 0, 0), Size=50, ExtentX=expression_2, ExtentY=expression_2)  # -> Cells, flatten(Points)
series = Series(Start=0, Step=1, Count=lng)
dv = DisplayGraphVertex(Graph=dtg, GraphPoints=pop3d, GraphVertexIndex=graft(series), indexTyp=1)  # -> flatten(Degree), Neighbours, Cost
split = SplitList(List=pop3d, Index=lng)  # -> ListA, ListB
sc = SphereCollide(Points=split.ListA, Radius=1, Strength=10)
item_9 = ListItem(List=split.ListA, Index=py3.sourceIndex, Wrap=True)
item_10 = ListItem(List=split.ListA, Index=py3.targetIndex, Wrap=True)
expression_3 = Expression(x=dv.Degree, y=Slider(4, range=0..100), Expression="x>y")
xy_5 = XYPlane(Origin=Point(0, 0, 0))
ln = Line(StartPoint=item_9, EndPoint=item_10)
len_4 = Length(Curve=ln)
mindex_2 = MemberIndex(Set=flatten(expression_3), Member=Toggle(True))  # -> Index, Count
expression_4 = Expression(x=len_4, Expression="x<0.5")
dispatch_3 = Dispatch(List=ln, DispatchPattern=expression_4)  # -> ListA, ListB
item_11 = ListItem(List=pop3d, Index=mindex_2.Index, Wrap=True)
item_12 = ListItem(List=py3.nodes, Index=mindex_2.Index, Wrap=True)
onplane = OnPlane(Points=split.ListA, Plane=xy_5, Strength=100)
length_line = LengthLine(Line=dispatch_3.ListB, Length=1, Strength=1)
item_13 = ListItem(List=item_12, Index=0, Wrap=True)
py3_3 = Python3Script(x=item_13)  # -> out, a
# ---------- py3_3: Python ----------
import requests
import Rhino as rh
import json
url = "https://archmanucox.pythonanywhere.com/bimverse/nodes-light/{}.json/".format(x)
node = requests.get(url).json()
a = node["data"]["Name"]
# ---------- end py3_3 ----------
solver = Solver(GoalObjects=flatten([sc, length_line, onplane]), Reset=Button(), Threshold=1e-15, Tolerance=0.0001, On=Toggle(True))  # -> I, V, O
stepsolver = StepSolver(Tolerance=0.0001, Momentum=False, Damping=0.99, SubIterations=1, Animate=Slider(84, range=0..100))  # -> I, V, O
panel_11 = Panel(py3_3.a)
item_14 = ListItem(List=solver.V, Index=mindex_2.Index, Wrap=True)
